# Grasshopper definition Dominoptimo2.gh (Grasshopper 1.0.7)
# plug-ins: Tomaso, Bifocals

pipeline = GeometryPipeline(
    GroupByLayer=False,
    GroupByType=False,
    IncludeHidden=True,
    IncludeLocked=True,
    LayerFilter="C3",
    NameFilter="*",
    SublayerFiltering=False,
    TypeFilter=4)
pipeline_2 = GeometryPipeline(
    GroupByLayer=False,
    GroupByType=False,
    IncludeHidden=True,
    IncludeLocked=True,
    LayerFilter="S1",
    NameFilter="*",
    SublayerFiltering=False,
    TypeFilter=1073741848)
pipeline_3 = GeometryPipeline(
    GroupByLayer=False,
    GroupByType=False,
    IncludeHidden=True,
    IncludeLocked=True,
    LayerFilter="C1",
    NameFilter="*",
    SublayerFiltering=False,
    TypeFilter=4)
pipeline_4 = GeometryPipeline(
    GroupByLayer=False,
    GroupByType=False,
    IncludeHidden=True,
    IncludeLocked=True,
    LayerFilter="C2",
    NameFilter="*",
    SublayerFiltering=False,
    TypeFilter=4)
pipeline_5 = GeometryPipeline(
    GroupByLayer=False,
    GroupByType=False,
    IncludeHidden=True,
    IncludeLocked=True,
    LayerFilter="C4",
    NameFilter="*",
    SublayerFiltering=False,
    TypeFilter=4)
pipeline_6 = GeometryPipeline(
    GroupByLayer=False,
    GroupByType=False,
    IncludeHidden=True,
    IncludeLocked=True,
    LayerFilter="R2",
    NameFilter="*",
    SublayerFiltering=False,
    TypeFilter=1)
pipeline_7 = GeometryPipeline(
    GroupByLayer=False,
    GroupByType=False,
    IncludeHidden=True,
    IncludeLocked=True,
    LayerFilter="W1",
    NameFilter="*",
    SublayerFiltering=False,
    TypeFilter=1073741848)
pipeline_8 = GeometryPipeline(
    GroupByLayer=False,
    GroupByType=False,
    IncludeHidden=True,
    IncludeLocked=True,
    LayerFilter="G1",
    NameFilter="*",
    SublayerFiltering=False,
    TypeFilter=4)
pipeline_9 = GeometryPipeline(
    GroupByLayer=False,
    GroupByType=False,
    IncludeHidden=True,
    IncludeLocked=True,
    LayerFilter="G2",
    NameFilter="*",
    SublayerFiltering=False,
    TypeFilter=4)
pipeline_10 = GeometryPipeline(
    GroupByLayer=False,
    GroupByType=False,
    IncludeHidden=True,
    IncludeLocked=True,
    LayerFilter="G3",
    NameFilter="*",
    SublayerFiltering=False,
    TypeFilter=4)
pipeline_11 = GeometryPipeline(
    GroupByLayer=False,
    GroupByType=False,
    IncludeHidden=True,
    IncludeLocked=True,
    LayerFilter="B1",
    NameFilter="*",
    SublayerFiltering=False,
    TypeFilter=4)
pipeline_12 = GeometryPipeline(
    GroupByLayer=False,
    GroupByType=False,
    IncludeHidden=True,
    IncludeLocked=True,
    LayerFilter="GL-X",
    NameFilter="*",
    SublayerFiltering=False,
    TypeFilter=1)
pipeline_13 = GeometryPipeline(
    GroupByLayer=False,
    GroupByType=False,
    IncludeHidden=True,
    IncludeLocked=True,
    LayerFilter="R1",
    NameFilter="*",
    SublayerFiltering=False,
    TypeFilter=1)
pipeline_14 = GeometryPipeline(
    GroupByLayer=False,
    GroupByType=False,
    IncludeHidden=True,
    IncludeLocked=True,
    LayerFilter="GL-Y",
    NameFilter="*",
    SublayerFiltering=False,
    TypeFilter=1)

nwmdl = NewModel(Run=Button())

geo = Geometry(pipeline_14)
geo_2 = Geometry(pipeline_12)
sort_pt = SortPoints(Points=geo)  # -> Points, Indices
sort_pt_2 = SortPoints(Points=geo_2)  # -> Points, Indices
pdecon = Deconstruct(Point=sort_pt_2.Points)  # -> XComponent, YComponent, ZComponent
pdecon_2 = Deconstruct(Point=sort_pt.Points)  # -> XComponent, YComponent, ZComponent
panel = Panel("""A
B""")
panel_2 = Panel("""1
2
3
4""")

geo_3 = Geometry(pipeline_7)
lng = ListLength(List=geo_3)
series = Series(Start=1, Step=1, Count=lng)
meshoption = ValueList({"Default", "Auto Rectangular", "Mesh Nv x Nh"}, selected="Auto Rectangular")
addrestraints = ValueList({"Yes", "No"}, selected="Yes")
int = Integer(series)
value = ValueList({"F11": 1, "F22": 1, "F33": 1, "M11": 0.35, "M22": 0.35, "M12": 0.35, "V13": 1, "V23": 1, "Mass": 1, "Weight": 1}, selected=["F11", "F22", "F33", "M11", "M22", "M12", "V13", "V23", "Mass", "Weight"])
button = Button()
concat = Concatenate(FragmentA="W1-", FragmentB=int)

geo_4 = Geometry(pipeline_11)
lng_2 = ListLength(List=geo_4)
series_2 = Series(Start=1, Step=1, Count=lng_2)
int_2 = Integer(series_2)
concat_2 = Concatenate(FragmentA="B1-", FragmentB=int_2)

geo_5 = Geometry(pipeline_2)
lng_3 = ListLength(List=geo_5)
series_3 = Series(Start=1, Step=1, Count=lng_3)
meshoption_2 = ValueList({"Default", "No Mesh", "Auto Cookie Cut", "Mesh Nv x Nh"}, selected="No Mesh")
dir = ValueList({"Local 1 axis": 1, "Local 2 axis": 2, "Local 3 axis": 3, "X direction": 4, "Y direction": 5, "Z direction": 6, "Projected X direction": 7, "Projected Y direction": 8, "Projected Z direction": 9, "Gravity direction": 10, "Projected Gravity direction": 11}, selected="Projected Z direction")
addrestraints_2 = ValueList({"Yes", "No"}, selected="Yes")
value_2 = ValueList({"F11": 1, "F22": 1, "F33": 1, "M11": 0.35, "M22": 0.35, "M12": 0.35, "V13": 1, "V23": 1, "Mass": 1, "Weight": 1}, selected=["F11", "F22", "F33", "M11", "M22", "M12", "V13", "V23", "Mass", "Weight"])
int_3 = Integer(series_3)
button_2 = Button()
csys = ValueList({"Global", "Local"}, selected="Global")
expression = Expression(x=Slider(40, range=0..100), Expression="x/1000/144")
concat_3 = Concatenate(FragmentA="S1-", FragmentB=int_3)

startvalue_endvalue = ValueList({"Axial": 0, "Shear 2": 1, "Shear 3": 2, "Torsion": 3, "Moment 22": 4, "Moment 33": 5}, selected=["Axial", "Shear 2", "Shear 3", "Torsion", "Moment 22", "Moment 33"])
startvalue_endvalue_2 = ValueList({"Axial": 0, "Shear 2": 1, "Shear 3": 2, "Torsion": 3, "Moment 22": 4, "Moment 33": 5}, selected=["Moment 22", "Moment 33"])
insertion_point = ValueList({"Bottom Left": 1, "Bottom Center": 2, "Bottom Right": 3, "Middle Left": 4, "Middle Center": 5, "Middle Right": 6, "Top Left": 7, "Top Center": 8, "Top Right": 9, "Centroid": 10, "Shear Center": 11}, selected="Top Center")
value_3 = ValueList({"Area": 1, "As2": 1, "As3": 1, "Torsion": 1, "I22": 0.35, "I33": 0.35, "Mass": 1, "Weight": 1}, selected=["Area", "As2", "As3", "Torsion", "I22", "I33", "Mass", "Weight"])
replace = ReplaceItems(List=[False, False, False, False, False, False], Item=True, Indices=startvalue_endvalue, Wrap=False)
replace_2 = ReplaceItems(List=[False, False, False, False, False, False], Item=True, Indices=startvalue_endvalue_2, Wrap=False)

drwflrwallobjcts = DrawFloorWallObjects(Run=button_2, Area=geo_5, Name=concat_3, PropName="Slab1", UserName=concat_3, CSys="Global")
dfnslbsctn = DefineSlabSlabSection(Run=button_2, Name="Slab1", SlabType=0, ShellType=1, MatProp="4000psi", Thickness=6, Color=-1)
assnshllatflrmshoptns = AssignShellFloorAutoMeshOptions(Run=button_2, Name=concat_3, MeshOption=meshoption_2, AddRestraints=addrestraints_2)
assgnshllldsunfrm = AssignShellLoadsUniform(Run=button_2, Name=concat_3, LoadPat="Live", Dir=dir, Value=expression, CSys=csys, Replace=True, ItemType=0)
assgnshllstffnssmdfrs = AssignShellStiffnessModifiers(Run=button_2, Name=concat_3, Value=value_2, ItemType=0)

# ----
# S-GRID-HORZ
# S-GRID-VERT
# S-JOIN
# S-COLS
# S-WALL
# S-BEAM
# S-SLAB
pipeline_15 = GeometryPipeline(
    GroupByLayer=False,
    GroupByType=False,
    IncludeHidden=True,
    IncludeLocked=True,
    LayerFilter="GL-Z",
    NameFilter="*",
    SublayerFiltering=False,
    TypeFilter=1)
entwine = Entwine(Branch00=pipeline_8, Branch01=pipeline_9, Branch02=pipeline_10, FlattenInputs=True)
entwine_2 = Entwine(Branch00=pipeline_3, Branch01=pipeline_4, Branch02=pipeline, Branch03=pipeline_5, FlattenInputs=True)
entwine_3 = Entwine(Branch00=pipeline_13, Branch01=pipeline_6, FlattenInputs=True)
edtgrd = EditGrid(
    Run=Button(),
    Name="G1",
    XValue=pdecon.XComponent,
    XLabel=panel_2,
    XBubbleLocation="Start",
    XBubbleVisible="Yes",
    YValue=pdecon_2.YComponent,
    YLabel=panel,
    YBubbleLocation="Start",
    YBubbleVisible="Yes")

geo_6 = Geometry(pipeline_15)
sort_pt_3 = SortPoints(Points=geo_6)  # -> Points, Indices
pdecon_3 = Deconstruct(Point=sort_pt_3.Points)  # -> XComponent, YComponent, ZComponent
shift = ShiftList(List=pdecon_3.ZComponent, Shift=1, Wrap=True)
split = SplitList(List=pdecon_3.ZComponent, Index=1)  # -> ListA, ListB
subtraction = Subtraction(A=shift, B=pdecon_3.ZComponent)
cull_i = CullIndex(List=subtraction, Indices=-1, Wrap=True)
lng_4 = ListLength(List=cull_i)
panel_3 = Panel("""L2
L3""")

geo_7 = Geometry(entwine)
lng_5 = ListLength(List=geo_7)
series_4 = Series(Start=1, Step=1, Count=lng_5)
panel_4 = Panel("""G1-
G2-
G3-""")
int_4 = Integer(series_4)
button_3 = Button()
concat_4 = Concatenate(FragmentA=graft(panel_4), FragmentB=int_4)

geo_8 = Geometry(entwine_3)
lng_6 = ListLength(List=geo_8)
series_5 = Series(Start=1, Step=1, Count=lng_6)
panel_5 = Panel("""R1-
R2-""")
value_4 = ValueList({"UX": 0, "UY": 1, "UZ": 2, "RX": 3, "RY": 4, "RZ": 5}, selected=["UX", "UY", "UZ", "RX", "RY", "RZ"])
int_5 = Integer(series_5)
button_4 = Button()
concat_5 = Concatenate(FragmentA=panel_5, FragmentB=int_5)
replace_3 = ReplaceItems(List=[False, False, False, False, False, False], Item=True, Indices=value_4, Wrap=False)

geo_9 = Geometry(entwine_2)
lng_7 = ListLength(List=geo_9)
series_6 = Series(Start=1, Step=1, Count=lng_7)
startvalue_endvalue_3 = ValueList({"Axial": 0, "Shear 2": 1, "Shear 3": 2, "Torsion": 3, "Moment 22": 4, "Moment 33": 5}, selected=["Axial", "Shear 2", "Shear 3", "Torsion", "Moment 22", "Moment 33"])
insertion_point_2 = ValueList({"Bottom Left": 1, "Bottom Center": 2, "Bottom Right": 3, "Middle Left": 4, "Middle Center": 5, "Middle Right": 6, "Top Left": 7, "Top Center": 8, "Top Right": 9, "Centroid": 10, "Shear Center": 11}, selected="Centroid")
int_6 = Integer(series_6)
panel_6 = Panel("""C1-
C2-
C3-
C4-""")
value_5 = ValueList({"Area": 1, "As2": 1, "As3": 1, "Torsion": 1, "I22": 0.7, "I33": 0.7, "Mass": 1, "Weight": 1}, selected=["Area", "As2", "As3", "Torsion", "I22", "I33", "Mass", "Weight"])
button_5 = Button()
concat_6 = Concatenate(FragmentA=panel_6, FragmentB=int_6)
replace_4 = ReplaceItems(List=[False, False, False, False, False, False], Item=True, Indices=startvalue_endvalue_3, Wrap=False)

editstories = EditStories(
    Run=Button(),
    BaseElevation=split.ListA,
    NumberStories=lng_4,
    StoryNames=panel_3,
    StoryHeights=cull_i,
    SimilarToStory="None",
    SpliceAbove=False,
    SpliceHeight=0,
    Color=255)

drwjntobjcts = DrawJointObjects(Run=button_4, Point=geo_8, Name=concat_5, UserName=concat_5, CSys="Global", MergeOff=False, MergeNumber=0)
assgnjntrstrnts = AssignJointRestraints(Run=button_4, Name=concat_5, Value=replace_3, ItemType=0)

drwbmclmnbrc = DrawBeamColumnBraceObject(Run=button_5, Line=geo_9, Name=concat_6, PropName="ConcCol", UserName=concat_6, CSys="Global")
assgnfrminsrtnpt = AssignFrameInsertionPoint(
    Run=button_5,
    Name=concat_6,
    CardinalPoint=insertion_point_2,
    Mirror2=False,
    StiffTransform=False,
    Offset1=0,
    Offset2=0,
    CSys="Local",
    ItemType=0)
assgnfrmrlssprtlfxty = AssignFrameReleasesPartialFixity(
    Run=button_5,
    Name=concat_6,
    II=replace_4,
    JJ=replace_4,
    StartValue=[0, 0, 0, 0, 0, 0],
    EndValue=[0, 0, 0, 0, 0, 0],
    ItemType=0)
assgnfrmprprtymdfrs = AssignFramePropertyModifiers(Run=button_5, Name=concat_6, Value=value_5, ItemType=0)

dfnprlbls = DefinePierLabels(Run=button, Name="P1")
drwflrwallobjcts_2 = DrawFloorWallObjects(Run=button, Area=geo_3, Name=concat, PropName="Wall1", UserName=concat, CSys="Global")
assgnshllprlbl = AssignShellPierLabel(Run=button, Name=concat, PierName="P1", ItemType=0)
assnshllatwllmshoptns = AssignShellWallAutoMeshOptions(Run=Button(), Name=concat, MeshOption=meshoption, AddRestraints=addrestraints)
assgnshllstffnssmdfrs_2 = AssignShellStiffnessModifiers(Run=button, Name=concat, Value=value, ItemType=0)

drwbmclmnbrc_2 = DrawBeamColumnBraceObject(Run=button_3, Line=geo_7, Name=concat_4, PropName="ConcBm", UserName=concat_4, CSys="Global")
assgnfrminsrtnpt_2 = AssignFrameInsertionPoint(
    Run=button_3,
    Name=concat_4,
    CardinalPoint=insertion_point,
    Mirror2=False,
    StiffTransform=False,
    Offset1=0,
    Offset2=0,
    CSys="Local",
    ItemType=0)
assgnfrmrlssprtlfxty_2 = AssignFrameReleasesPartialFixity(
    Run=button_3,
    Name=concat_4,
    II=replace,
    JJ=replace,
    StartValue=[0, 0, 0, 0, 0, 0],
    EndValue=[0, 0, 0, 0, 0, 0],
    ItemType=0)
assgnfrmprprtymdfrs_2 = AssignFramePropertyModifiers(Run=button_3, Name=concat_4, Value=value_3, ItemType=0)

drwbmclmnbrc_3 = DrawBeamColumnBraceObject(Run=Button(), Line=geo_4, Name=concat_2, PropName="ConcBm", UserName=concat_2, CSys="Global")
assgnfrminsrtnpt_3 = AssignFrameInsertionPoint(
    Run=button_3,
    Name=concat_2,
    CardinalPoint=insertion_point,
    Mirror2=False,
    StiffTransform=False,
    Offset1=0,
    Offset2=0,
    CSys="Local",
    ItemType=0)
assgnfrmrlssprtlfxty_3 = AssignFrameReleasesPartialFixity(
    Run=button_3,
    Name=concat_2,
    II=replace_2,
    JJ=replace_2,
    StartValue=[0, 0, 0, 0, 0, 0],
    EndValue=[0, 0, 0, 0, 0, 0],
    ItemType=0)
assgnfrmprprtymdfrs_3 = AssignFramePropertyModifiers(Run=button_3, Name=concat_2, Value=value_3, ItemType=0)

gtfrmsctns = GetFrameSections(Run=Toggle(True))  # -> NumberNames, MyName, PropType, T3, T2, Tf, Tw, T2b, Tfb, Area
entwine_4 = Entwine(
    Branch00=gtfrmsctns.MyName,
    Branch01=gtfrmsctns.PropType,
    Branch02=gtfrmsctns.T3,
    Branch03=gtfrmsctns.T2,
    Branch04=gtfrmsctns.Tf,
    Branch05=gtfrmsctns.Tw,
    Branch06=gtfrmsctns.T2b,
    Branch07=gtfrmsctns.Tfb,
    Branch08=gtfrmsctns.Area,
    FlattenInputs=True)
keysearch = KeyValueSearch(Keys=gtfrmsctns.MyName, Values=entwine_4, Search="ConcCol")
flip = FlipMatrix(Data=keysearch)
item = ListItem(List=flip, Index=0, Wrap=True)  # -> flatten(Item), flatten(Item1), flatten(Item2), flatten(Item3), flatten(Item4), flatten(Item5), flatten(Item6), flatten(Item7)
rectangle = Rectangle(Plane=PlaneXY(0, 0, 0), XSize=item.Item2, YSize=item.Item1, Radius=0)  # -> Rectangle, Length
X = UnitX(Factor=expr("-x/2", item.Item2))
move = Move(Geometry=rectangle.Rectangle, Motion=X)  # -> Geometry, Transform
Y = UnitY(Factor=expr("-x/2", item.Item1))
move_2 = Move(Geometry=move.Geometry, Motion=Y)  # -> Geometry, Transform
boundary = BoundarySurfaces(Edges=move_2.Geometry)
extrude = ExtrudeLinear(Profile=boundary, OrientationP=PlaneXY(0, 0, 0), Axis=geo_9)

gtfrmsctns_2 = GetFrameSections(Run=Toggle(True))  # -> NumberNames, MyName, PropType, T3, T2, Tf, Tw, T2b, Tfb, Area
entwine_5 = Entwine(
    Branch00=gtfrmsctns_2.MyName,
    Branch01=gtfrmsctns_2.PropType,
    Branch02=gtfrmsctns_2.T3,
    Branch03=gtfrmsctns_2.T2,
    Branch04=gtfrmsctns_2.Tf,
    Branch05=gtfrmsctns_2.Tw,
    Branch06=gtfrmsctns_2.T2b,
    Branch07=gtfrmsctns_2.Tfb,
    Branch08=gtfrmsctns_2.Area,
    FlattenInputs=True)
keysearch_2 = KeyValueSearch(Keys=gtfrmsctns_2.MyName, Values=entwine_5, Search="ConcBm")
flip_2 = FlipMatrix(Data=keysearch_2)
item_2 = ListItem(List=flip_2, Index=0, Wrap=True)  # -> flatten(Item), flatten(Item1), flatten(Item2), flatten(Item3), flatten(Item4), flatten(Item5), flatten(Item6), flatten(Item7)
rectangle_2 = Rectangle(Plane=PlaneXY(0, 0, 0), XSize=item_2.Item2, YSize=item_2.Item1, Radius=0)  # -> Rectangle, Length
X_2 = UnitX(Factor=expr("-x/2", item_2.Item2))
move_3 = Move(Geometry=rectangle_2.Rectangle, Motion=X_2)  # -> Geometry, Transform
Y_2 = UnitY(Factor=expr("-x/2", item_2.Item1))
move_4 = Move(Geometry=move_3.Geometry, Motion=Y_2)  # -> Geometry, Transform
boundary_2 = BoundarySurfaces(Edges=move_4.Geometry)
extrude_2 = ExtrudeLinear(Profile=boundary_2, OrientationP=PlaneXY(0, 0, 0), Axis=geo_4)

gtfrmsctns_3 = GetFrameSections(Run=Toggle(True))  # -> NumberNames, MyName, PropType, T3, T2, Tf, Tw, T2b, Tfb, Area
entwine_6 = Entwine(
    Branch00=gtfrmsctns_3.MyName,
    Branch01=gtfrmsctns_3.PropType,
    Branch02=gtfrmsctns_3.T3,
    Branch03=gtfrmsctns_3.T2,
    Branch04=gtfrmsctns_3.Tf,
    Branch05=gtfrmsctns_3.Tw,
    Branch06=gtfrmsctns_3.T2b,
    Branch07=gtfrmsctns_3.Tfb,
    Branch08=gtfrmsctns_3.Area,
    FlattenInputs=True)
keysearch_3 = KeyValueSearch(Keys=gtfrmsctns_3.MyName, Values=entwine_6, Search="ConcBm")
flip_3 = FlipMatrix(Data=keysearch_3)
item_3 = ListItem(List=flip_3, Index=0, Wrap=True)  # -> flatten(Item), flatten(Item1), flatten(Item2), flatten(Item3), flatten(Item4), flatten(Item5), flatten(Item6), flatten(Item7)
rectangle_3 = Rectangle(Plane=PlaneXY(0, 0, 0), XSize=item_3.Item2, YSize=item_3.Item1, Radius=0)  # -> Rectangle, Length
X_3 = UnitX(Factor=expr("-x/2", item_3.Item2))
move_5 = Move(Geometry=rectangle_3.Rectangle, Motion=X_3)  # -> Geometry, Transform
Y_3 = UnitY(Factor=expr("-x/2", item_3.Item1))
move_6 = Move(Geometry=move_5.Geometry, Motion=Y_3)  # -> Geometry, Transform
boundary_3 = BoundarySurfaces(Edges=move_6.Geometry)
extrude_3 = ExtrudeLinear(Profile=boundary_3, OrientationP=PlaneXY(0, 0, 0), Axis=geo_7)
